# Grasshopper definition ur_online_control_gh_group_04.gh (Grasshopper 1.0.7)
# plug-ins: Bifocals, Spirale

# ---- group: Infilled prototype
pt = Point(Point(107.3565245, 84.56936952, 0))  # disabled
pt_2 = Point(Point(0, 0, 0))  # disabled
input = DataInput(
    Destination="C:\Users\a\repos\mini_eggshell\design\group_04\week_2_infilled_prototype_2-1.ghdata",
    RelativePath="C:\Users\a\repos\mini_eggshell\design\group_04\week_2_infilled_prototype_2-1.ghdata|..\..\design\group_04\week_2_infilled_prototype_2-1.ghdata",
    UpdateDelay=5)  # disabled
vec2pt = Vector2Pt(PointA=pt_2, PointB=pt, Unitize=False)  # -> Vector, Length; disabled
number_slider = Slider(5, range=0..10)  # disabled
move = Move(Geometry=input, Motion=vec2pt.Vector)  # -> Geometry, Transform; disabled
Z = UnitZ(Factor=number_slider)  # disabled
move_2 = Move(Geometry=move.Geometry, Motion=Z)  # -> Geometry, Transform; disabled
pt_3 = Point(move_2.Geometry)  # disabled
number_slider_2 = Slider(2000, range=0..10000)  # disabled
split = SplitList(List=flatten(pt_3), Index=number_slider_2)  # -> ListA, ListB; disabled
number_slider_3 = Slider(4000, range=0..10000)  # disabled
split_2 = SplitList(List=split.ListB, Index=number_slider_3)  # -> ListA, ListB; disabled
split_3 = SplitList(List=split_2.ListB, Index=number_slider_3)  # -> ListA, ListB; disabled

# ---- group: Overhang tester
number_slider_4 = Slider(199, range=0..500)  # disabled
number_slider_5 = Slider(163, range=0..1000)  # disabled
number_slider_6 = Slider(100, range=0..100)  # disabled
pt_4 = Point(Point(-5.21856941, 93.65677316, 0))  # disabled
division = Division(A=number_slider_4, B2=2)  # disabled
addition = Addition(A=number_slider_5, B=division)  # disabled
circle = CircleCNR(Center=pt_4, Normal=Vector(0, 0, 1), Radius=number_slider_5)  # disabled
Z_2 = UnitZ(Factor=number_slider_6)  # disabled
move_3 = Move(Geometry=pt_4, Motion=Z_2)  # -> Geometry, Transform; disabled
scale = Scale(Center=Point(0, 0, 0), Factor=0.5)  # -> Geometry, Transform; disabled
circle_2 = CircleCNR(Center=move_3.Geometry, Normal=Vector(0, 0, 1), Radius=addition)  # disabled
end = EndPoints(Curve=circle)  # -> Start, End; disabled
end_2 = EndPoints(Curve=circle_2)  # -> Start, End; disabled
loft = Loft(
    Curves=[circle_2, circle],
    Options={Adjust=False, Closed=False, LoftEnds=0, LoftSimp=0, LoftType=0, Rebuild=10, Refit=0.01})  # disabled
vec2pt_2 = Vector2Pt(PointA=pt_4, PointB=end.Start, Unitize=False)  # -> Vector, Length; disabled
vec2pt_3 = Vector2Pt(PointA=end.Start, PointB=end_2.Start, Unitize=False)  # -> Vector, Length; disabled
vdis = VectorDisplay(Anchor=end.Start, Vector=vec2pt_3.Vector)  # disabled
angle = Angle(VectorA=vec2pt_2.Vector, VectorB=vec2pt_3.Vector)  # -> Angle, Reflex; disabled
deg = Degrees(Radians=angle.Angle)  # disabled
scale_2 = Scale(Geometry=loft, Center=Point(0, 0, 0), Factor=0.5)  # -> Geometry, Transform; disabled
panel = Panel(deg)  # disabled

# ---- group: Test mesh sim casting
mesh = Mesh(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)

# ---- group: Input mesh
# Polymorph part
mesh_2 = Mesh(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)

# ---- group: Test spiral / Center point
# Center point
number_slider_7 = Slider(-10, range=-20..10)
pt_5 = Point(Point(253.2165127, 53.33895303, 0))
Z_3 = UnitZ(Factor=number_slider_7)
move_4 = Move(Geometry=pt_5, Motion=Z_3)  # -> Geometry, Transform

# ----
pt_6 = Point(Point(185.4777967, 55.77893947, 22))

# ---- group: Tutorial geometry
# -10 is good start z for print
# layer height = 4
# for the mid size nozzle
panel_2 = Panel("-181 bottom extruder")
panel_3 = Panel("-172")
number_slider_8 = Slider(10, range=0..100)
number_slider_9 = Slider(5, range=0..100)
pt_7 = ConstructPoint(XCoordinate=Slider(0, range=-100..200), YCoordinate=Slider(-175, range=-500..350), ZCoordinate="-10")
range = Range(D0To1=Domain(0, 1), Steps=number_slider_9)
cir = Circle(Plane=pt_7, Radius=Slider(115, range=0..150))
series = Series(Start=0, Step=number_slider_8, Count=number_slider_9)
Z_4 = UnitZ(Factor=series)
integer_division = IntegerDivision(A=number_slider_8, B2=2)
move_5 = Move(Geometry=cir, Motion=Z_4)  # -> Geometry, Transform
pipe = Pipe(Curve=move_5.Geometry, Radius=integer_division, Caps=1)  # -> flatten(Pipe)
graph = GraphMapper(
    range,
    x0=0,
    x1=1,
    y0=0,
    y1=1,
    container_name="Sine",
    Equation_px=[0.06322468072, 1],
    Equation_py=[0.3642850518, 0.9405152202])
panel_4 = Panel(Z_4)
cap = CapHoles(Brep=pipe)
area = Area(Geometry=move_5.Geometry)  # -> Area, Centroid
cull_i = CullIndex(List=graph, Indices=-1, WTrue=True)
scale_3 = Scale(Geometry=move_5.Geometry, Center=area.Centroid, Factor=cull_i)  # -> Geometry, Transform
divide = DivideCurve(Curve=scale_3.Geometry, Count=Slider(10, range=0..100), KFalse=False)  # -> Points, Tangents, Parameters

# ----
pdecon = Deconstruct(Point=pt_6)  # -> XComponent, YComponent, ZComponent
pt_8 = ConstructPoint(XCoordinate=pdecon.XComponent, YCoordinate=pdecon.YComponent, ZCoordinate=Slider(10, range=0..100))
cyl = Cylinder(Base=pt_8, Radius=Slider(60, range=0..1000), Length=Slider(100, range=0..1000))

# ---- group: Test spiral / Main geometry
# Main geometry
number_slider_10 = Slider(30, range=0..100)
Z_5 = UnitZ(Factor=1)
spiral = Spirale(
    AxisStart=move_4.Geometry,
    AxisDirection=Z_5,
    HelixStart=Point(0, 1, 0),
    Pitch=Slider(2, range=0..10),
    TurnCount=number_slider_10,
    R1=number_slider_10,
    R2=number_slider_10)

# ----
mesh_3 = MeshBrep(
    Brep=cyl,
    Settings={GridMaxCount=0, GridMinCount=16, JaggedSeams=False, MaxEdgeLength=0, MinEdgeLength=0.0001, MinTolerance=0, Refine=True, RefineAngle=0, RelativeTolerance=0.65, SimplePlanes=True, Tolerance=0})

# ---- group: Test spiral / Start circle
# Start circle
cir_2 = Circle(Plane=move_4.Geometry, Radius=number_slider_10)

# ---- group: Settings
distance_between_pts = Slider(5, range=0..50)
number_slider_11 = Slider(6, range=-30..30)
number_slider_12 = Slider(0, range=0..100)
number_slider_13 = Slider(4, range=0..20)

distance_between_pts_2 = Slider(10, range=0..50)
number_slider_14 = Slider(6, range=-30..30)
number_slider_15 = Slider(45, range=0..100)
number_slider_16 = Slider(4.5, range=0..20)

# ---- group: Test spiral / Make circle seam meet spiral
# Make circle seam meet spiral
number_slider_17 = Slider(90, range=0..1000)
area_2 = Area(Geometry=cir_2)  # -> Area, Centroid
rotate = Rotate(Geometry=cir_2, Angle=degrees(number_slider_17), Plane=area_2.Centroid)  # -> Geometry, Transform
explode = Explode(Curve=rotate.Geometry, Recursive=True)  # -> Segments, Vertices

# ----
cyl_2 = Cylinder(BWorldXY=PlaneXY(0, 0, 0), Radius=0.5, Length=1)

autoannotate = AutoAnnotate(enable=Toggle(True))  # inputs enable: Boolean, types: list
# ---------- autoannotate: Python ----------
"""
Adds annotations to internalized input parameters for all components on the canvas.
using the format `X=Y`. Completely reversible via toggling the `enable` input. 
Default enabled types are Boolean, Integer, Number, String, Interval, and Plane, 
connect a Value List to the `types` input to enable others.
"""
from Grasshopper.Kernel import Types, Parameters, GH_Component
from Grasshopper.Kernel.Special import GH_ValueList, GH_ValueListItem, GH_ValueListMode
this = ghenv.Component

# region RUN_ONCE_ONLY

# Crazy self-modifying hack to remove default parameters "x, y, a" if they have no wires connected
# this block of code between #region and #endregion will be commented out after the first time the code runs.

from Grasshopper.Kernel import GH_ParameterSide

reversible = False

if reversible:
    # comment out the region by surrounding it in triple quotes
    newcode = this.Code.replace("\n# region RUN_ONCE_ONLY", "\n# region RUN_ONCE_ONLY\n\"\"\"")
    newcode = newcode.replace("\n# endregion RUN_ONCE_ONLY", "\n\"\"\"# endregion RUN_ONCE_ONLY")
else:
    # cut the entire region out irreversibly
    newcode = this.Code.partition("\n# region RUN_ONCE_ONLY")[0] + this.Code.rpartition("\n# endregion RUN_ONCE_ONLY")[-1]


def callback(doc):
    for pos, pm in enumerate(list(this.Params.Input)):
        if pm.NickName in "xy" and pm.SourceCount == 0:
            this.DestroyParameter(GH_ParameterSide.Input, pos)
            this.Params.UnregisterInputParameter(pm)

    for pos, pm in enumerate(list(this.Params.Output)):
        if pm.NickName == "a" and pm.Recipients.Count == 0:
            this.DestroyParameter(GH_ParameterSide.Output, pos)
            this.Params.UnregisterOutputParameter(pm)

    if this.IsCodeInputLinked():
        this.CodeInputParam.Sources.Clear()
    this.CodeInputParam.Script_ClearPersistentData()
    this.CodeInputParam.SetPersistentData(newcode)
    this.VariableParameterMaintenance()


this.OnPingDocument().ScheduleSolution(1, callback)


def ensure_input(name, hint=None, access=0):
    if this.Params.Input.Find(lambda p: p.NickName == name):
        return

    def callback(doc):
        from Grasshopper.Kernel import GH_ParameterSide, GH_ParamAccess
        pos = this.Params.Input.Count
        pm = this.CreateParameter(GH_ParameterSide.Input, pos)
        pm.NickName = name
        default_hint = this.GetType().Assembly.GetType("GhPython.Component.NoChangeHint")()
        pm.TypeHint = default_hint if not isinstance(hint, Parameters.IGH_TypeHint) else hint
        pm.Access = GH_ParamAccess.ToObject(GH_ParamAccess, access)
        this.Params.RegisterInputParam(pm, pos)
        this.VariableParameterMaintenance()

    this.OnPingDocument().ScheduleSolution(1, callback)


ensure_input("enable", hint=Parameters.Hints.GH_BooleanHint_CS())
ensure_input("types", access=1)

# endregion RUN_ONCE_ONLY

ann_types = [Types.GH_Boolean, Types.GH_Integer, Types.GH_Number, Types.GH_String, Types.GH_Interval, Types.GH_Plane,
             Types.GH_Point, Types.GH_Vector, Types.GH_ComplexNumber, Types.GH_Colour, Types.GH_Time]
# first N types in the list to be enabled for annotation.
# connect value list for more options
default_idx = 6
# truncates the annotation if above N characters -
# prevents long strings from expanding the component width too much
maxlen = 20

this.Name = "AutoAnnotate"

types_param = this.Params.Input.Find(lambda p: p.NickName == "types")
types_param.Description = "Connect a Value List for more options"
vallist = types_param.Sources[0] if types_param.SourceCount == 1 else None
if isinstance(vallist, GH_ValueList):
    if len(ann_types) != vallist.ListItems.Count:
        # clear and rebuild the list
        vallist.ListMode = GH_ValueListMode.CheckList
        vallist.ListItems.Clear()
        for i, _type in enumerate(ann_types):
            typename = _type().TypeName
            item = GH_ValueListItem(typename, typename)
            item.Selected = (i < default_idx)
            vallist.ListItems.Insert(i, item)
        vallist.Attributes.ExpireLayout()
        vallist.Attributes.PerformLayout()
    ann_types = [t for t, b in zip(ann_types, vallist.SaveState()) if b == "Y"]
else:
    ann_types = ann_types[:default_idx]

for obj in this.OnPingDocument().Objects:
    if not isinstance(obj, GH_Component):
        continue
    has_changed = False
    for param in obj.Params.Input:
        if not hasattr(param, "PersistentData"):
            # less overhead than testing if assignable from generic type GH_PersistentParam[T]
            continue

        if isinstance(param, Parameters.Param_ScriptVariable) or param.Name == "code":
            # script variables depend on their nicknames, do not mess with them
            # also adding an exception for the "code" input of GhPython component
            continue

        try:
            assert enable
            assert param.SourceCount == 0
            assert param.PersistentDataCount == 1
            pers_data = param.PersistentData[0][0]
            assert pers_data.GetType() in ann_types
            data_repr = pers_data.ToString()
            if isinstance(pers_data, Types.GH_String):
                data_repr = '"{}"'.format(data_repr)
            if len(data_repr) > maxlen:
                data_repr = data_repr[:maxlen] + u"\u2026"  # ellipsis
            param.NickName = param.NickName.partition("=")[0] + "=" + data_repr
            has_changed = True
        except AssertionError:
            if "=" in param.NickName:
                param.NickName = param.NickName.partition("=")[0]
                has_changed = True

    if has_changed:
        obj.Attributes.ExpireLayout()
        obj.Attributes.PerformLayout()
# ---------- end autoannotate ----------

# ----
# Polymorph slicer
cluster = Cluster(
    C=scale_2.Geometry,
    end_plane_rotation=number_slider_12,
    distance_between_points=distance_between_pts,
    distance_from_z0=number_slider_11,
    layer_height=number_slider_13)
pt_9 = Point(reverse(cluster))

move_amount_in_x_per_layer_mm = Slider(1, range=0..10)
curve_number_to_move_sidewards = Slider(0, range=0..100)
distance_between_points = Slider(20, range=0..100)
amount_of_layers = Slider(40, range=0..1000)
layer_height = Slider(3, range=0..10)

# ----
# 0a
# Check your IP address and set UR IP address
server_address = ValueList({"192.168.10.2", "192.168.10.11", "127.0.0.1"}, selected="192.168.10.11")
ur_ip = ValueList({"192.168.10.13", "192.168.10.11", "192.168.10.10", "127.0.0.1"}, selected="192.168.10.10")
server_port = Integer(30003)
globals = PythonScript(server_address=server_address, server_port=server_port, ur_ip=ur_ip)  # inputs server_port: Int32
# ---------- globals: Python ----------
from scriptcontext import sticky as st

st["server_address"] = server_address
st["server_port"] = server_port

st["ur_ip"] = ur_ip
# ---------- end globals ----------

# ----
# Check if UR is available
ping = Button()
py = PythonScript(ip=ur_ip, ping=ping)  # -> out
# ---------- py: Python ----------
from scriptcontext import sticky as st
from mini_eggshell.ur_online_control.ur_direct.utilities import is_available


guid = str(ghenv.Component.InstanceGuid)
txt_key = "txt_" + guid
if txt_key not in st:
    st[txt_key] = ""

if ping:
    
    available = is_available(ip)
    
    if available:
        st[txt_key] = "%s is up!" % ip
    else:
        st[txt_key] = "%s is down!" % ip

print st[txt_key]
# ---------- end py ----------
panel_5 = Panel(py)

# ---- group: Tutorial geometry / mm3 to Litres
volume = Volume(Geometry=cap)  # -> Volume, Centroid
multiplication = Multiplication(A=volume.Volume, B="0.000001")
ma = MassAddition(Input=multiplication)  # -> Result, PartialResults
panel_6 = Panel(ma.Result)

# ----
radius = Slider(58, range=0..1000)

# ---- group: Test spiral
crv = Curve(flatten([explode.Segments, spiral]))
divdist = DivideDistance(Curve=crv, Distance=Slider(5, range=0..10))  # -> Points, Tangents, Parameters

# ---- group: Visualization
pline = PolyLine(Vertices=cluster, CFalse=False)
explode_2 = Explode(Curve=pline, Recursive=True)  # -> Segments, Vertices

# ---- group: Centroid start pt print 2
pt_10 = Point(Point(284.518631, 201.1452026, 127.3320646))

# ---- group: Centroid start pt print 1
pt_11 = Point(Point(284.518631, 172.1452026, 10.33206463))

# ----
bang = Button()
panel_7 = Panel("Unload libraries")
unload = PythonScript(bang=bang)
# ---------- unload: Python ----------
from compas_ghpython import unload_modules

unload_modules("compas")
unload_modules("ur_online_control")
# ---------- end unload ----------

input_2 = DataInput(
    Destination="C:\Users\a\repos\mini_eggshell\design\group_04\week_2_infilled_prototype_2-1.ghdata",
    RelativePath="C:\Users\a\repos\mini_eggshell\design\group_04\week_2_infilled_prototype_2-1.ghdata|..\..\design\group_04\week_2_infilled_prototype_2-1.ghdata",
    UpdateDelay=5)
circle_3 = CircleCNR(Center=pt_10, Normal=Vector(0, 0, 1), Radius=radius)
series_2 = Series(Start=0, Step=layer_height, Count=amount_of_layers)

# ----
# 1. load robot model
# 2. set tool
# 3. set basis
nozzle_distance_from_holder = Slider(52, range=0..100)
base = PythonScript()  # -> base_frame, base
# ---------- base: Python ----------
from compas.geometry import Frame

"""
origin = [0, 0, 0]
xaxis = [1, 0, 0]
yaxis = [0, 1, 0]


origin = [-313.92, -147.58, 13.79]
xaxis = [0.00000, -1.00000, 0.00000]
yaxis = [1.00000, 0.00000, 0.00000]
"""

#axis    Y         Z                        X

origin = [-14.89, -373.34, -469.74]
xaxis = [-0.00473, -0.99998, -0.00304]
yaxis = [0.99998, -0.00474, 0.00418]

base_frame = Frame(list(origin), list(xaxis), list(yaxis))

base = "base = " + str(origin) + "\n"
# ---------- end base ----------
panel_8 = Panel(base.base)

# ----
# Settings
# 1. load robot model
# 2. set tool
# 3. set basis
list = ValueList({"no_tool": 0, "plastic_extruder": 1, "clay_extruder": 2, "clay_extruder_SS": 3, "clay_extruder_SS_alu": 4}, selected="clay_extruder_SS")
tools = Tools(tool_id=list, nozzle_distance_from_holder=nozzle_distance_from_holder)
list_2 = ValueList({"UR5", "UR10"}, selected="UR5")
robot = PythonScript(model=list_2, tool=tools, base_frame=base.base_frame)  # -> robot
# ---------- robot: Python ----------
from mini_eggshell.ur_online_control.ur.ur10 import UR10
from mini_eggshell.ur_online_control.ur.ur5 import UR5
from scriptcontext import sticky as st

if model == "UR5":
    robot = UR5()
elif model == "UR10":
    robot = UR10()

if tool:
    robot.set_tool(tool)
if base_frame:
    robot.set_base(base_frame)

st["robot"] = robot
# ---------- end robot ----------

Z_6 = UnitZ(Factor=series_2)
number_slider_18 = Slider(5000, range=0..100000)
pt_12 = Point(Point(0, 0, 0))
move_6 = Move(Geometry=circle_3, Motion=Z_6)  # -> Geometry, Transform
split_4 = SplitList(List=move_6.Geometry, Index=curve_number_to_move_sidewards)  # -> ListA, ListB
crv_2 = Curve(split_4.ListA)
crv_3 = Curve(split_4.ListB)
lng = ListLength(List=crv_3)
series_3 = Series(Start=0, Step=move_amount_in_x_per_layer_mm, Count=lng)
Y = UnitY(Factor=series_3)
pt_13 = Point(Point(1.764484005, 342.009372, 0))
move_7 = Move(Geometry=crv_3, Motion=Y)  # -> Geometry, Transform
Z_7 = UnitZ(Factor=Slider(19, range=0..40))
number_slider_19 = Slider(24, range=0..100)

# ----
# Polymorph slicer
cluster_2 = Cluster_2(
    C=mesh_3,
    end_plane_rotation=number_slider_15,
    distance_between_points=distance_between_pts_2,
    distance_from_z0=number_slider_19,
    layer_height=number_slider_16)  # -> print_path, planes
pt_14 = Point(reverse(cluster_2.print_path))

# ---- group: Visualization
pline_2 = PolyLine(Vertices=cluster_2.print_path, CFalse=False)
explode_3 = Explode(Curve=pline_2, Recursive=True)  # -> Segments, Vertices

# ----
end_3 = EndPoints(Curve=pline_2)  # -> Start, End
rotate_2 = Rotate(Geometry=cluster_2.planes, Angle=degrees(Slider(180, range=0..1000)), Plane=pt_8)  # -> Geometry, Transform
vec2pt_4 = Vector2Pt(PointA=pt_12, PointB=pt_13, Unitize=False)  # -> Vector, Length
split_5 = SplitList(List=reverse(rotate_2.Geometry), Index=number_slider_18)  # -> ListA, ListB
split_6 = SplitList(List=reverse(explode_3.Segments), Index=number_slider_18)  # -> ListA, ListB
merge = Merge(Data1=crv_2, Data2=move_7.Geometry)
move_8 = Move(Geometry=input_2, Motion=vec2pt_4.Vector)  # -> Geometry, Transform
Z_8 = UnitZ(Factor=Slider(200, range=0..1000))
crv_4 = Curve(split_6.ListA)
Z_9 = UnitZ(Factor=Slider(20, range=0..40))
move_9 = Move(Geometry=split_5.ListA, Motion=Z_8)  # -> Geometry, Transform
Z_10 = UnitZ(Factor=number_slider_19)
divdist_2 = DivideDistance(Curve=flatten(merge), Distance=distance_between_points)  # -> Points, Tangents, Parameters
X = UnitX(Factor=1)
pln = Plane(split_5.ListA)
move_10 = Move(Geometry=move_8.Geometry, Motion=Z_10)  # -> Geometry, Transform
rev = Reverse(Vector=X)
pline_3 = PolyLine(Vertices=flatten(divdist_2.Points), CFalse=False)
pt_15 = Point(move_10.Geometry)
align = AlignPlane(Plane=pln, Direction=rev)  # -> Plane, Angle
number_slider_20 = Slider(4000, range=0..10000)
move_11 = Move(Geometry=divdist_2.Points, Motion=Z_9)  # -> Geometry, Transform
split_7 = SplitList(List=align.Plane, Index=Slider(15, range=0..100))  # -> ListA, ListB

# ---- group: First print
pline_4 = PolyLine(
    Vertices=Tree({0;0}: [Point(342.518631, 172.1452026, 32.33206463), Point(339.0703551, 191.8456949, 32.33206463), Point(329.1355484, 209.2036791, 32.33206463), Point(313.8955197, 222.1551857, 32.33206463), Point(295.1624008, 229.1602021, 32.33206463), Point(275.1636731, 229.3857893, 32.33206463)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], {0;1}: [Point(342.518631, 172.1452026, 35.33206463), Point(339.0703551, 191.8456949, 35.33206463), Point(329.1355484, 209.2036791, 35.33206463), Point(313.8955197, 222.1551857, 35.33206463), Point(295.1624008, 229.1602021, 35.33206463), Point(275.1636731, 229.3857893, 35.33206463)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], {0;2}: [Point(342.518631, 172.1452026, 38.33206463), Point(339.0703551, 191.8456949, 38.33206463), Point(329.1355484, 209.2036791, 38.33206463), Point(313.8955197, 222.1551857, 38.33206463), Point(295.1624008, 229.1602021, 38.33206463), Point(275.1636731, 229.3857893, 38.33206463)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], {0;3}: [Point(342.518631, 172.1452026, 41.33206463), Point(339.0703551, 191.8456949, 41.33206463), Point(329.1355484, 209.2036791, 41.33206463), Point(313.8955197, 222.1551857, 41.33206463), Point(295.1624008, 229.1602021, 41.33206463), Point(275.1636731, 229.3857893, 41.33206463)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], {0;4}: [Point(342.518631, 172.1452026, 44.33206463), Point(339.0703551, 191.8456949, 44.33206463), Point(329.1355484, 209.2036791, 44.33206463), Point(313.8955197, 222.1551857, 44.33206463), Point(295.1624008, 229.1602021, 44.33206463), Point(275.1636731, 229.3857893, 44.33206463)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], {0;5}: [Point(342.518631, 172.1452026, 47.33206463), Point(339.0703551, 191.8456949, 47.33206463), Point(329.1355484, 209.2036791, 47.33206463), Point(313.8955197, 222.1551857, 47.33206463), Point(295.1624008, 229.1602021, 47.33206463), Point(275.1636731, 229.3857893, 47.33206463)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]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),
    CFalse=False)

# ----
pln_2 = Plane(split_7.ListA)
split_8 = SplitList(List=flatten(pt_15), Index=Slider(4000, range=0..10000))  # -> ListA, ListB
pln_3 = Plane(move_11.Geometry)
split_9 = SplitList(List=split_8.ListB, Index=number_slider_20)  # -> ListA, ListB
split_10 = SplitList(List=split_9.ListB, Index=number_slider_20)  # -> ListA, ListB
rotate_3 = Rotate(Geometry=pln_3, Angle=degrees(Slider(90, range=0..100)), Plane=pln_3)  # -> Geometry, Transform

# ---- group: Fabrication planes
pln_4 = Plane(flatten(align.Plane))

# ----
number_slider_21 = Slider(315, range=-360..360)
pln_5 = Plane(flatten(pln_4))
number_slider_22 = Slider(180, range=0..1000)
rotate_4 = Rotate(Geometry=pln_5, Angle=degrees(number_slider_21), Plane=pln_5)  # -> Geometry, Transform

# ---- group: Origin
pt_16 = Point(Point(0, 0, -12))

# ---- group: Safety z offset
Z_11 = UnitZ(Factor=Slider(5, range=0..5))
move_12 = Move(Geometry=pt_16, Motion=Z_11)  # -> Geometry, Transform

# ---- group: safe_pt
pt_17 = Point(Point(45.85484744, 405.8875635, 281.5630479))
xy = XYPlane(Origin=pt_17)
rotate_5 = Rotate(Geometry=xy, Angle=degrees(number_slider_21), Plane=xy)  # -> Geometry, Transform

# ---- group: Define commands
safe_speed = Slider(25, range=0..300)
# 1
number_slider_23 = Slider(50, range=0..100)
speed = Slider(25, range=0..300)
planes_wcs = Plane(rotate_4.Geometry)
python = PythonScript(planes_WCS=planes_wcs, dfillet=number_slider_23, speed=speed, safe_speed=safe_speed, safe_pt=rotate_5.Geometry)  # -> commands; inputs planes_WCS: list of Plane, speed: Int32, safe_pt: Plane
# ---------- python: Python ----------
import Rhino.Geometry as rg
from compas.geometry import Frame
from compas.geometry import Transformation
from scriptcontext import sticky as st


robot = st["robot"]
buffer = 0.5

commands = []

def generate_cmds(planes_WCS, dfillet, speed, safe_speed, safe_pt):

    # add safe_pt as a starting point
    tcp_WCS_safe_pt = Frame(safe_pt.Origin, safe_pt.XAxis, safe_pt.YAxis)

    tcp_RCS_safe_pt = robot.get_frame_in_RCS(tcp_WCS_safe_pt)
    cmd_safe_pt = list(tcp_RCS_safe_pt.point) + tcp_RCS_safe_pt.axis_angle_vector + [safe_speed, 0]
    commands.append(cmd_safe_pt)


    # TODO this must be optimized! matrix multiplication!

    for i, plane_WCS in enumerate(planes_WCS):
        tcp_WCS = Frame(plane_WCS.Origin, plane_WCS.XAxis, plane_WCS.YAxis)
        if i == 0 or i == len(planes_WCS) - 1:
            radius = 0.

        else:
            # calculate blend radius
            prev, current, next = planes_WCS[i-1].Origin, planes_WCS[i].Origin, planes_WCS[i+1].Origin
            # print((prev - current).Length/2 * buffer, (next - current).Length/2 * buffer, dfillet)
            radius = min((prev - current).Length/2 * buffer, (next - current).Length/2 * buffer, dfillet)
            radius = round(radius,5)
        print(radius)
        # print()


        tcp_RCS = robot.get_frame_in_RCS(tcp_WCS)
        cmd = list(tcp_RCS.point) + tcp_RCS.axis_angle_vector + [speed, radius]
        commands.append(cmd)


    # add safe_pt as an end point
    commands.append(cmd_safe_pt)
    return commands


commands = generate_cmds(planes_WCS, dfillet, speed, safe_speed, safe_pt)

print commands[0]
# ---------- end python ----------

# ---- group: test_pt
pt_18 = Point(Point(143.5449512, -50.24639294, 319.3127676))
xy_2 = XYPlane(Origin=move_12.Geometry)
rotate_6 = Rotate(Geometry=xy_2, Angle=degrees(Slider(0, range=0..1000)), Plane=xy_2)  # -> Geometry, Transform

# ----
pln_6 = Plane(planes_wcs)

# ---- group: save_commands
py_2 = PythonScript()  # -> path
# ---------- py_2: Python ----------
import sys
import os

ghComp = ghenv.Component
ghDoc = ghComp.OnPingDocument()

# the full path of the gh file
path = ghDoc.FilePath
# the directory of the gh file
path = os.path.dirname(path)

path = os.path.abspath(os.path.join(path, ".."))

print path
# ---------- end py_2 ----------
start_safe_pt = BooleanToggle(False)
continue_fabrication = BooleanToggle(True)
# 3
panel_9 = Panel(py_2)
save_json = Button()
commands = Data(python)
send = PythonScript(
    path=panel_9,
    continue_fabrication=continue_fabrication,
    commands=commands,
    start_at_safe_pt=start_safe_pt,
    save_json=save_json,
    name_json="commands_group_04.json")  # -> out; inputs continue_fabrication: Int32, commands: list, start_at_safe_pt: Boolean
# ---------- send: Python ----------
import json
import os

from mini_eggshell.ur_online_control.communication.msg_identifiers import *
from mini_eggshell.ur_online_control.utilities.lists import flatten_list
from time import sleep

#number of values per command to be formatted 
len_command = len(commands[0])
gh_commands = flatten_list(commands)


#to print in gh panel
print len_command, "values each command"
print len(gh_commands)/len_command, "commands." , len(gh_commands), "values"

if start_at_safe_pt is None: start_at_safe_pt = True

if start_at_safe_pt:
    print "Starting at safe point"
else:
    print "Starting at first frame of geometry"


data = {}
data['start_at_safe_pt'] = start_at_safe_pt
data['len_command'] = len_command
data['gh_commands'] = gh_commands


filename = os.path.join(path, name_json)
if save_json:
    with open(filename, 'w') as f:
        json.dump(data, f)
# ---------- end send ----------

# ----
panel_10 = Panel(send)
merge_2 = Merge(Data1=rotate_5.Geometry, Data2=pln_6)
item = ListItem(List=pln_6, Index=0, WTrue=True)  # -> Item1, Item, Item1_2
pln_7 = Plane([item.Item, item.Item1_2])

# ----
# Direct UR control
get = Button()
get_2 = Button()
pose = PythonScript(get=get_2)  # -> pose_joints
# ---------- pose: Python ----------
from scriptcontext import sticky as st
from mini_eggshell.ur_online_control.ur_direct import get_current_pose_joints
from mini_eggshell.ur_online_control.ur.robot import BaseConfiguration

server_address = st["server_address"]
server_port = 30005
ur_ip = st["ur_ip"]
robot = st["robot"]
tool_angle_axis = list(robot.tool.tcp_frame.point) + list(robot.tool.tcp_frame.axis_angle_vector)
print tool_angle_axis

guid = str(ghenv.Component.InstanceGuid)
pose_joints_key = "pose_joints" + guid

if get:
    st[pose_joints_key] = get_current_pose_joints(server_address, server_port, ur_ip, tool_angle_axis)
    
if pose_joints_key not in st:
    pose_joints = []
else:
    pose_joints = BaseConfiguration.from_joints(st[pose_joints_key])
# ---------- end pose ----------
pose_2 = PythonScript(get=get)  # -> pose_cartesian
# ---------- pose_2: Python ----------
from scriptcontext import sticky as st
from mini_eggshell.ur_online_control.ur_direct import get_current_pose_cartesian

server_address = st["server_address"]
server_port = 30005
ur_ip = st["ur_ip"]
robot = st["robot"]

tool_angle_axis = list(robot.tool.tcp_frame.point) + robot.tool.tcp_frame.axis_angle_vector
print tool_angle_axis

guid = str(ghenv.Component.InstanceGuid)
pose_cartesian_key = "pose_cartesian" + guid


if get:
    st[pose_cartesian_key] = get_current_pose_cartesian(server_address, server_port, ur_ip, tool_angle_axis)

if pose_cartesian_key not in st:
    pose_cartesian = []
else:
    pose_cartesian = st[pose_cartesian_key]
# ---------- end pose_2 ----------
stop = Button()
stop_2 = PythonScript(stop=stop)
# ---------- stop_2: Python ----------
from scriptcontext import sticky as st
from mini_eggshell.ur_online_control.ur_direct import stop as stop_robot

ur_ip = st["ur_ip"]

if stop:
    stop_robot(ur_ip)
# ---------- end stop_2 ----------
panel_11 = Panel(pose_2)
panel_12 = Panel(pose)

# ----
# 2
# Visualisation
robot_2 = Data(robot)
pose_joints = Data(pose)
planes_wcs_2 = Plane(pln_7)

# ----
# 0b
vertical_pose = Number([-152.427, -780.635, 855.229, -1.1958, -1.22046, -1.20201])

# ---- group: Define plane in WCS, calculate joint positions
pt_19 = Point(Point(-283.8412985, -342.877576, 297.4189147))
select_configuration = Slider(1, range=0..7)
xy_3 = XYPlane(Origin=pt_19)
plane_wcs = Plane(xy_3)
inverse = PythonScript(robot=robot_2, plane_WCS=plane_wcs, idx=select_configuration)  # -> configuration; inputs plane_WCS: Plane, idx: Int32
# ---------- inverse: Python ----------
import Rhino.Geometry as rg
from compas.geometry import Frame, Transformation
#from compas_ghpython import xdraw_frame

tcp_WCS = Frame(plane_WCS.Origin, plane_WCS.XAxis, plane_WCS.YAxis)

# transform frame to robot coordinate system
tcp_RCS = robot.get_frame_in_RCS(tcp_WCS)

# get the frame of tool0
tool0_RCS = robot.get_tool0_frame_from_tcp_frame(tcp_RCS)

# calculate solutions to frame
solutions = robot.inverse_kinematics(tool0_RCS)

if not len(solutions):
    q = [0,0,0,0,0,0]
else:
    idx = min(len(solutions) - 1, idx)
    q = solutions[idx]
    
print q

configuration = q
# ---------- end inverse ----------

# ---- group: Origin
data = Data(["79.3845", "-766.842", "-435.007", "-0.69844", "1.52248", "0.732284"])

# ----
back = Button()
reset = Button()

# ---- group: Calculate joint positions for path
# Add init joint states
joint_states = Data([-0.1728179112, -1.415058186, 1.813991282, -1.971940356, -1.571654205, -3.308720436])
init_configuration = Slider(2, range=0..7)
py_3 = PythonScript(robot=robot_2, planes_WCS=planes_wcs_2, configuration_idx=init_configuration, init_configuration=joint_states)  # -> configurations; inputs planes_WCS: list, configuration_idx: Int32, init_configuration: list
# ---------- py_3: Python ----------
from compas_ghpython import unload_modules
unload_modules('ur_online_control')
import Rhino.Geometry as rg
from compas.geometry import Frame 
from compas.geometry.xforms import Transformation
#from compas_ghpython import xdraw_frame
from ur_online_control.ur.kinematics import calculate_configurations_for_path, format_joint_positions


# TODO this must be optimized! matrix multiplication!
frames_tool0_RCS = []
for plane_WCS in planes_WCS:
    tcp_WCS = Frame(plane_WCS.Origin, plane_WCS.XAxis, plane_WCS.YAxis)
    tcp_RCS = robot.get_frame_in_RCS(tcp_WCS)
    frames_tool0_RCS.append(robot.get_tool0_frame_from_tcp_frame(tcp_RCS))
    

#configurations = calculate_configurations_for_path(frames_tool0_RCS, robot.params, init_configuration)
configurations = calculate_configurations_for_path(frames_tool0_RCS, robot, init_configuration)
print configurations
configurations = configurations[min([configuration_idx, len(configurations) - 1])]

def format(numbers, k=4):
    #numbers = format_joint_positions(numbers)
    return "[" + ", ".join([("%." + str(k) + "f") % n for n in numbers]) + "]"
# ---------- end py_3 ----------
start = Button()
stop_3 = Button()
step = Button()
counter = CountThroughList(L=py_3, start=start, stop=stop_3, step=step, step_back=back, reset=reset, interval=50)  # -> item; inputs L: list, start: Boolean, stop: Boolean, step_back: Boolean
# ---------- counter: Python ----------
from scriptcontext import sticky as st
from compas_ghpython import update_component


# store data in component
guid = str(ghenv.Component.InstanceGuid)
counter_key = "counter_" + guid
running_key = "running_" + guid

if counter_key not in st:
    st[counter_key] = 0

if running_key not in st:
    st[running_key] = False

if start:
    st[running_key] = True

if stop:
    st[running_key] = False

if step:
    if st[counter_key] < len(L) - 1:
        st[counter_key] += 1

if step_back:
    if st[counter_key] < len(L) - 1:
        st[counter_key] -= 1

if reset:
    st[counter_key] = 0

if len(L):
    item = L[st[counter_key]]

if st[running_key]:
    if st[counter_key] < len(L) - 1:
        st[counter_key] += 1
        update_component(ghenv, interval)
    else:
        st[counter_key] = 0
        st[running_key] = False
# ---------- end counter ----------

# ---- group: Calculate joint positions for path / Shows joint positions along path
flip = BooleanToggle(True)
l2t = PythonScript(L=py_3, flip=flip)  # -> T; inputs L: list, flip: Boolean
# ---------- l2t: Python ----------
from compas_ghpython import list_to_ghtree
L = [l.joint_values for l in L]

if flip:
    L = zip(*L)
T = list_to_ghtree(L)
# ---------- end l2t ----------
graph_2 = QuickGraph(l2t, SortOrder=0)

# ---- group: Define joint positions
base_2 = Slider(90.163, range=-360..360)
shoulder = Slider(0, range=-360..360)
elbow = Slider(-102.857, range=-360..360)
wrist2 = Slider(0, range=-360..360)
wrist3 = Slider(0, range=-360..360)
wrist1 = Slider(0, range=-360..360)
ur1_q1_q6 = Data([base_2, shoulder, elbow, wrist1, wrist2, wrist3])

# ----
# Measure basis:
# 1. Clear the recorded poses
# 2. Move robot to origin and press "get pose"
# 3. Move robot to point in positive x-axis and press "get pose"
# 4. Move robot to an other point in your basis and press "get pose"
# (The farer away these positions are, the better)
# 
# 5. Alternatively change the order in the component calc base
# 6. Copy output into base component
# Calculate basis
list_3 = ValueList({"origin, pt on positive x-axis, pt in xy plane": 0, "origin, pt on positive y-axis, pt in xy plane": 1}, selected="origin, pt on positive x-axis, pt in xy plane")
clear = Button()
rec = PythonScript(msg=pose_2, rec=get, clear=clear)  # -> rec; inputs msg: list
# ---------- rec: Python ----------
from scriptcontext import sticky as st

guid = str(ghenv.Component.InstanceGuid)
recorded_key =  "recorded_" + guid
just_cleared_key = "just_cleared_" + guid

if recorded_key not in st:
    st[recorded_key] = []

if just_cleared_key not in st:
    st[just_cleared_key] = False

if clear:
    st[recorded_key] = []
    st[just_cleared_key] = True
else:
    if len(msg):
        if msg != [None] and not st[just_cleared_key] and rec:
            st[recorded_key].append(msg)
    st[just_cleared_key] = False
        


rec = st[recorded_key]

print rec
# ---------- end rec ----------
calc_base = PythonScript(poses=rec, input_type=list_3)  # -> out; inputs poses: list
# ---------- calc_base: Python ----------
import Rhino.Geometry as rg
import math


if len(poses) > 2:
    
    O = poses[0]
    P1 = poses[1]
    P2 = poses[2]
    
    if input_type == 0:
        # origin, pt on positive x-axis, pt in xy plane
        origin = rg.Point3d(O[0], O[1], O[2])
        pt_on_xaxis = rg.Point3d(P1[0], P1[1], P1[2])
        pt_in_xyplane = rg.Point3d(P2[0], P2[1], P2[2])
        
        xaxis = pt_on_xaxis - origin
        xaxis.Unitize()
        
        v = pt_in_xyplane - origin
        zaxis = rg.Vector3d.CrossProduct(v, xaxis)
        zaxis.Unitize()
        
        # zaxis must look up!
        if math.acos(rg.Vector3d.ZAxis * zaxis) > math.acos(rg.Vector3d.ZAxis * -zaxis):
            zaxis = -zaxis
        
        yaxis = rg.Vector3d.CrossProduct(zaxis, xaxis)
    
    elif input_type == 1:
        # origin, pt on positive y-axis, pt in xy plane
        origin = rg.Point3d(O[0], O[1], O[2])
        pt_on_yaxis = rg.Point3d(P1[0], P1[1], P1[2])
        pt_in_xyplane = rg.Point3d(P2[0], P2[1], P2[2])
        
        yaxis = pt_on_yaxis - origin
        yaxis.Unitize()
        
        v = pt_in_xyplane - origin
        zaxis = rg.Vector3d.CrossProduct(v, yaxis)
        zaxis.Unitize()
        
        # zaxis must look up!
        if math.acos(rg.Vector3d.ZAxis * zaxis) > math.acos(rg.Vector3d.ZAxis * -zaxis):
            zaxis = -zaxis
        
        xaxis = rg.Vector3d.CrossProduct(yaxis, zaxis)
        
        
    print "Copy the following into base component:"
    print " "
    print "origin = [%.2f, %.2f, %.2f]" % tuple(list(origin))
    print "xaxis = [%.5f, %.5f, %.5f]" % tuple(list(xaxis))
    print "yaxis = [%.5f, %.5f, %.5f]" % tuple(list(yaxis))
    

#print rg.Vector3d.CrossProduct(rg.Vector3d.YAxis, rg.Vector3d.ZAxis)
#print rg.Vector3d.CrossProduct(rg.Vector3d.ZAxis, rg.Vector3d.XAxis)
# ---------- end calc_base ----------
panel_13 = Panel(rec)
panel_14 = Panel(calc_base)

py_4 = GhPythonScript(joint_values=ur1_q1_q6)  # -> configuration; inputs joint_values: list
# ---------- py_4: Python ----------
import math
from ur_online_control.ur.robot import BaseConfiguration

configuration = BaseConfiguration.from_joints([math.radians(d) for d in joint_values])
# ---------- end py_4 ----------

# ---- group: Visualise / robot model brep
py_5 = PythonScript(model=list_2)  # -> n
# ---------- py_5: Python ----------
if model == "UR5":
    n = 0
if model == "UR10":
    n = 1

print n
# ---------- end py_5 ----------
ur10_brep = UR10Brep([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])
ur5_brep = UR5Brep([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])
show_brep = BooleanToggle(False)
filter = StreamFilter(Gate=py_5, Stream0=ur5_brep, Stream1=ur10_brep)

# ---- group: Visualise
list_4 = ValueList({"0 forward, from angles": 0, "1 inverse, from one plane": 1, "2 inverse, from multiple planes": 2, "3 forward, from robot": 3}, selected="2 inverse, from multiple planes")
filter_2 = StreamFilter(Gate=list_4, Stream0=py_4, Stream1=inverse, Stream2=counter, Stream3=pose_joints)
configuration = Panel(filter_2)
mesh_4 = Mesh(filter)
draw = PythonScript(robot=robot_2, configuration=filter_2, mesh=mesh_4, brep=filter, show_brep=show_brep)  # -> meshes, tool0_plane, tcp_plane, robot_brep; inputs mesh: list, brep: list
# ---------- draw: Python ----------
from compas_ghpython import unload_modules
unload_modules("ur_online_control")

#from compas_ghpython import xdraw_frame
from compas_ghpython import mesh_draw
from compas_ghpython.geometry.xforms import xform_from_transformation
from compas.geometry import Frame
from compas.geometry.xforms import Transformation
from mini_eggshell.ur_online_control.ur.robot import BaseConfiguration

import Rhino.Geometry as rg
import Rhino

def mesh_update_vertices(mesh, vertices):
    for i in range(len(vertices)):
        mesh.vertex[i].update({'x': vertices[i][0], 'y': vertices[i][1], 'z': vertices[i][2]})

if configuration:
    #print configuration
    #q = BaseConfiguration.from_joints(configuration)
    q = configuration
    print q
    print q.joint_values
    
    print robot.get_forward_transformations(q)
    R0, R1, R2, R3, R4, R5 = robot.get_forward_transformations(q)
    
    tool0_frame2 = robot.tool0_frame.transformed(R5)
    tcp_frame2 = Frame.from_transformation(Transformation.from_frame(tool0_frame2) * robot.transformation_tool0_tcp)
    
    print robot.transformation_tool0_tcp
    print robot.transformation_tcp_tool0
    print robot.transformation_tool0_tcp * robot.transformation_tcp_tool0
    print tcp_frame2
    tcp_frame2 = Frame.from_transformation(Transformation.from_frame(tool0_frame2) * robot.transformation_tcp_tool0)
    print tcp_frame2
    
    tool0_frame, tcp_frame = robot.get_transformed_tool_frames(R5)
    
    tool0_frame = tool0_frame2
    tcp_frame = tcp_frame2
    
    m0, m1, m2, m3, m4, m5 = mesh
    for i in range(6):
        exec("R%drg = xform_from_transformation(R%d)" % (i, i))
        exec("m%d.Transform(R%drg)" % (i, i))
    meshes = [m0, m1, m2, m3, m4, m5]
    print meshes
    mt = robot.tool.get_transformed_model(Transformation.from_frame(tool0_frame))
    
    if mt:
        meshes.extend(map(mesh_draw, mt))
    
    """
    m0, m1, m2, m3, m4, m5, tool0_frame, tcp_frame = robot.get_transformed_model(q)
    mt = robot.get_transformed_tool_model(tcp_frame)
    
    meshes = []
    meshes.append(mesh_draw(m0))
    meshes.append(mesh_draw(m1))
    meshes.append(mesh_draw(m2))
    meshes.append(mesh_draw(m3))
    meshes.append(mesh_draw(m4))
    meshes.append(mesh_draw(m5))
    if mt:
        meshes.append(mesh_draw(mt))
    
    """
    
#    tool0_plane = xdraw_frame(tool0_frame)
#    tcp_plane = xdraw_frame(tcp_frame)
    
    if show_brep:
        
        b0, b1, b2, b3, b4, b5 = brep
        
        b0.Transform(R0rg)
        b1.Transform(R1rg)
        b2.Transform(R2rg)
        b3.Transform(R3rg)
        b4.Transform(R4rg)
        b5.Transform(R5rg)
        
        robot_brep = [b0, b1, b2, b3, b4, b5]
# ---------- end draw ----------
tool0_plane = Plane(draw.tool0_plane)
tcp_plane = Plane(draw.tcp_plane)
robot_brep = Brep(draw.robot_brep)
draw_2 = RepresentPlaneAsLines(plane=tcp_plane, size=100)  # -> G, C
# ---------- draw_2: Python ----------
import Rhino.Geometry as rg
from System.Drawing import Color

if plane:

    G = []
    G.append(rg.Line(plane.Origin, size * plane.XAxis))
    G.append(rg.Line(plane.Origin, size * plane.YAxis))
    G.append(rg.Line(plane.Origin, size * plane.ZAxis))
    
    C = []
    C.append(Color.FromArgb(255, 0, 0))
    C.append(Color.FromArgb(0, 255, 0))
    C.append(Color.FromArgb(0, 0, 255))
# ---------- end draw_2 ----------
preview = CustomPreview(Geometry=draw_2.G, Shader=draw_2.C)
preview_2 = CustomPreview(Geometry=draw.meshes, Shader=ColourSwatch(SwatchColor=RGBA(99, 94, 94, 96)))

# ---- group: Send joint position directly to robot
panel_15 = Panel("move cartesian")
idx = Slider(0, range=0..100)
commands_2 = Data(python)
item_2 = ListItem(List=commands_2, Index=idx, WTrue=True)
list_5 = ValueList({"send all positions": 0, "send only one position": 1}, selected="send only one position")
filter_3 = StreamFilter(Gate=list_5, Stream0=commands_2, Stream1=item_2)
movel = PythonScript(commands=filter_3, velocity=Slider(100, range=0..100))  # -> script; inputs commands: list
# ---------- movel: Python ----------
from scriptcontext import sticky as st

script_lines = []
for cmd in commands:
    #q, a=1.4, v=1.05, t=0, r=0)
    x, y, z, ax, ay, az, speed, radius = cmd
    script_lines.append("movel(p%s, v=%f, r=%f)" % (str([x/1000., y/1000., z/1000, ax, ay, az]), speed/1000., radius/1000.))

robot = st["robot"]
tool_angle_axis = list(robot.tool.tcp_frame.point) + robot.tool.tcp_frame.axis_angle_vector
x, y, z, ax, ay, az = tool_angle_axis

script = "def prog():\n"
script += "\ttextmsg(\">> program start\")\n"
script += "\tset_tcp(p%s)\n" % str([x/1000., y/1000., z/1000, ax, ay, az])
script += "".join(["\t%s\n" % line for line in script_lines])
script += "\ttextmsg(\"<< program end\")\n"
script += "end\n"
script += "prog()\n\n"

print script
# ---------- end movel ----------
send_2 = Button()
send_3 = Send(script=movel, send=send_2)
panel_16 = Panel(send_3)

# ----
panel_17 = Panel("move vertical")
movel_2 = PythonScript()  # -> script
# ---------- movel_2: Python ----------
from scriptcontext import sticky as st

robot = st["robot"]

tool_angle_axis = list(robot.tool.tcp_frame.point) + robot.tool.tcp_frame.axis_angle_vector
x, y, z, ax, ay, az = tool_angle_axis

script = "def prog():\n"
script += "\ttextmsg(\">> program start\")\n"
script += "\tset_tcp(p%s)\n" % str([x/1000., y/1000., z/1000, ax, ay, az])
script += "\tcurrent_pose = get_forward_kin()\n"
script += "\tmovel(p[current_pose[0], current_pose[1], current_pose[2], 0, 0, 0], a=0.1, v=0.1)\n"
script += "\ttextmsg(\"<< program end\")\n"
script += "end\n"
script += "prog()\n\n"

print script
# ---------- end movel_2 ----------
send_4 = Button()
send_5 = Send(script=movel_2, send=send_4)
panel_18 = Panel(send_5)

panel_19 = Panel("set digital out")
value = BooleanToggle(False)
number = Slider(0, range=0..10)
digital_out = PythonScript(number=number, value=value)  # -> script; inputs number: Int32, value: Boolean
# ---------- digital_out: Python ----------
script = "def prog():\n"
script += "\ttextmsg(\">> program start\")\n"
script += "\tset_digital_out(%i, %s)\n" % (int(number), str(value))
script += "\ttextmsg(\"<< program end\")\n"
script += "end\n"
script += "prog()\n\n"

print script
# ---------- end digital_out ----------
send_6 = Button()
send_7 = Send(script=digital_out, send=send_6)
panel_20 = Panel(send_7)

# ----
# move incremental in WCS
number_slider_24 = Slider(5, range=-10..10)
list_6 = ValueList({"xaxis", "yaxis", "zaxis"}, selected="zaxis")
movel_3 = PythonScript(step_size=number_slider_24, direction=list_6)  # -> script
# ---------- movel_3: Python ----------
from scriptcontext import sticky as st

robot = st["robot"]
tool_angle_axis = list(robot.tool.tcp_frame.point) + robot.tool.tcp_frame.axis_angle_vector
x, y, z, ax, ay, az = tool_angle_axis

script = "def prog():\n"
script += "\ttextmsg(\">> program start\")\n"
script += "\tset_tcp(p%s)\n" % str([x/1000., y/1000., z/1000, ax, ay, az])
script += "\tcurrent_pose = get_forward_kin()\n"


if direction == "xaxis":
    script += "\tmovel(p[current_pose[0] + %f, current_pose[1], current_pose[2], current_pose[3], current_pose[4], current_pose[5]], t=%f)\n" % (step_size/1000., step_size * 0.1)

elif direction == "yaxis":
    script += "\tmovel(p[current_pose[0], current_pose[1] + %f, current_pose[2], current_pose[3], current_pose[4], current_pose[5]], t=%f)\n" % (step_size/1000., step_size * 0.1)

else: # direction == "zaxis":
    script += "\tmovel(p[current_pose[0], current_pose[1], current_pose[2] + %f, current_pose[3], current_pose[4], current_pose[5]], t=%f)\n" % (step_size/1000., step_size * 0.1)

script += "\ttextmsg(\"<< program end\")\n"
script += "end\n"
script += "prog()\n\n"

print script
# ---------- end movel_3 ----------
send_8 = Button()
send_9 = Send(script=movel_3, send=send_8)
panel_21 = Panel(send_9)

# ----
# move incremental in TCS
get_current_pose = Button()
list_7 = ValueList({"xaxis", "yaxis", "zaxis"}, selected="zaxis")
movel_4 = PythonScript(get=get_current_pose, step_size=Slider(5, range=-10..10), direction=list_7)  # -> script; inputs get: list
# ---------- movel_4: Python ----------
from scriptcontext import sticky as st
from compas.geometry import Frame
from compas.geometry import Point, Vector
from mini_eggshell.ur_online_control.ur_direct import get_current_pose_cartesian

server_address = st["server_address"]
server_port = 30005
ur_ip = st["ur_ip"]
robot = st["robot"]
tool_angle_axis = list(robot.tool.tcp_frame.point) + robot.tool.tcp_frame.axis_angle_vector
print tool_angle_axis

guid = str(ghenv.Component.InstanceGuid)
pose_cartesian_key = "pose_cartesian" + guid

if get:
    st[pose_cartesian_key] = get_current_pose_cartesian(server_address, server_port, ur_ip, tool_angle_axis)

if pose_cartesian_key not in st:
    pose_cartesian = []
    script = ""
else:
    pose_cartesian = st[pose_cartesian_key]

    robot = st["robot"]
    tool_angle_axis = list(robot.tool.tcp_frame.point) + robot.tool.tcp_frame.axis_angle_vector
    x, y, z, ax, ay, az = tool_angle_axis
    
    script = "def prog():\n"
    script += "\ttextmsg(\">> program start\")\n"
    script += "\tset_tcp(p%s)\n" % str([x/1000., y/1000., z/1000, ax, ay, az])
    script += "\tcurrent_pose = get_forward_kin()\n"
    
#    frame = Frame.from_pose_axis_angle_vector(pose_cartesian)
    frame = Frame.from_axis_angle_vector([ax, ay, az])
    frame.point = [x, y, z]

    if direction == "xaxis":
        next_vector = Vector(*frame.xaxis) * step_size
    elif direction == "yaxis":
        next_vector = Vector(*frame.yaxis) * step_size
    else: # direction == "zaxis":
        next_vector = Vector(*frame.zaxis) * step_size
    
    x, y, z = next_vector
    script += "\tmovel(p[current_pose[0] + %f, current_pose[1] + %f, current_pose[2] + %f, current_pose[3], current_pose[4], current_pose[5]], t=%f)\n" % (x/1000., y/1000., z/1000., step_size * 0.1)
    
    script += "\ttextmsg(\"<< program end\")\n"
    script += "end\n"
    script += "prog()\n\n"
    
    print script
# ---------- end movel_4 ----------
send_10 = Button()
send_11 = Send(script=movel_4, send=send_10)
panel_22 = Panel(send_11)

# ----
# Joris slicer
mesh_5 = Mesh(<mesh referenced from the Rhino model>)
brep = Brep(<brep referenced from the Rhino model>)
slice = BooleanToggle(True)
layer_height_mm = Slider(1.5, range=0..10)
distance_between_points_mm = Slider(22.08, range=5..50)

# ---- group: input_geometry
geo = Geometry(brep)

# ----
slicer = GhPythonScript(slice=slice, input_geometry=geo, layer_height=layer_height_mm, distance_between_points=distance_between_points_mm)  # -> out, crvs, pts
# ---------- slicer: Python ----------
__author__ = "joburger"
__version__ = "2019.10.28"

import Rhino
import Rhino.Geometry as rg

import mini_eggshell.slicer.simple_slicer
reload(mini_eggshell.slicer.simple_slicer)

slicer = mini_eggshell.slicer.simple_slicer.Slicer(layer_height, distance_between_points)

if slice:
    if str(input_geometry.ObjectType) == "Mesh":
        print "Input geometry is of Mesh type"  
        crvs = slicer.create_contour_curves_from_mesh(input_geometry)
    elif str(input_geometry.ObjectType) == "Brep":
        print "Input geometry is of Brep type"
        crvs = slicer.create_contour_curves_from_brep(input_geometry)
    else:
        print "Input geometry not supported"
    
    pts = slicer.divide_curves_in_points()
# ---------- end slicer ----------

# ---- group: output_curves
crv_5 = Curve(slicer.crvs)

# ---- group: output_points
pt_20 = Point(slicer.pts)

# ----
pline_5 = PolyLine(Vertices=pt_20, CFalse=False)
move_13 = Move(Geometry=pt_20, Motion=Z_7)  # -> Geometry, Transform

# ---- group: Send joint position directly to robot
idx_2 = Slider(0, range=0..100)
panel_23 = Panel("move joints")
joint_positions = Data(py_3)
list_8 = ValueList({"send all positions": 0, "send only one position": 1}, selected="send only one position")
item_3 = ListItem(List=joint_positions, Index=idx_2, WTrue=True)
filter_4 = StreamFilter(Gate=list_8, Stream0=joint_positions, Stream1=item_3)
movej = PythonScript(joint_positions=filter_4, velocity=Slider(153, range=0..200))  # -> script; inputs joint_positions: list
# ---------- movej: Python ----------
script_lines = []

for position in joint_positions:
    script_lines.append("movej(%s, v=%f)" % (str(position), velocity/1000.))


script = "def prog():\n"
script += "\ttextmsg(\">> program start\")\n"
script += "".join(["\t%s\n" % line for line in script_lines])
script += "\ttextmsg(\"<< program end\")\n"
script += "end\n"
script += "prog()\n\n"


print script

#script = ""
# ---------- end movej ----------
send_12 = Button()

# ----
send_13 = Send(script=movej, send=send_12)

# ---- group: Send joint position directly to robot (continued)
panel_24 = Panel(send_13)

# ==== cluster Send
script = ClusterInput()
send = ClusterInput()
send_2 = PythonScript(script=script, send=send)  # -> out
# ---------- send_2: Python ----------
import socket
from scriptcontext import sticky as st

ur_ip = st['ur_ip']
ur_port = 30002

if send:
    s = socket.create_connection((ur_ip, ur_port), timeout=0.5) 
    s.send(script)
    s.close()
# ---------- end send_2 ----------
out = ClusterOutput(send_2)

# ==== cluster Tools
nozzle_distance_from_holder = ClusterInput()
tool_id = ClusterInput()
number_slider = Slider(180, range=0..1000)

# ---- group: plastic_extruder
brep = Brep([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])
xaxis_line = Curve(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)
yaxis_line = Curve(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)
test_geometry = Geometry(brep)
mesh = Mesh(test_geometry)
brep_2 = Brep(test_geometry)
tool = Tool(meshes=mesh, breps=brep_2, G=xaxis_line, G_2=yaxis_line)

# ---- group: no_tool
brep_3 = Brep(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)
yaxis_line_2 = Curve(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)
xaxis_line_2 = Curve(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)
test_geometry_2 = Geometry(brep_3)
mesh_2 = Mesh(test_geometry_2)
brep_4 = Brep(test_geometry_2)
tool_2 = Tool(meshes=mesh_2, breps=brep_4, G=xaxis_line_2, G_2=yaxis_line_2)

# ---- group: clay_extruder
brep_5 = Brep([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])
yaxis_line_3 = Curve(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)
xaxis_line_3 = Curve(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)
test_geometry_3 = Geometry(brep_5)
mesh_3 = Mesh(test_geometry_3)
brep_6 = Brep(test_geometry_3)
tool_3 = Tool(meshes=mesh_3, breps=brep_6, G=xaxis_line_3, G_2=yaxis_line_3)

# ---- group: clay_extruder_SS
brep_7 = Brep([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])
yaxis_line_4 = Curve(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)
xaxis_line_4 = Curve(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)
test_geometry_4 = Geometry(brep_7)
mesh_4 = Mesh(test_geometry_4)
brep_8 = Brep(test_geometry_4)
tool_4 = Tool(meshes=mesh_4, breps=brep_8, G=xaxis_line_4, G_2=yaxis_line_4, nozzle_distance_from_holder=nozzle_distance_from_holder)

# ----
tool_id_2 = Integer(tool_id)

# ---- group: clay_extruder_SS_alu_can
brep_9 = Brep([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])
xaxis_line_5 = Curve(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)
yaxis_line_5 = Curve(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)

# ----
rotate = Rotate(Geometry=brep_9, Angle=degrees(number_slider), Plane=PlaneXY(0, 0, 0))  # -> Geometry, Transform
rotate_2 = Rotate(Geometry=xaxis_line_5, Angle=degrees(number_slider), Plane=PlaneXY(0, 0, 0))  # -> Geometry, Transform
rotate_3 = Rotate(Geometry=yaxis_line_5, Angle=degrees(number_slider), Plane=PlaneXY(0, 0, 0))  # -> Geometry, Transform

# ---- group: clay_extruder_SS_alu_can (continued)
test_geometry_5 = Geometry(rotate.Geometry)
mesh_5 = Mesh(test_geometry_5)
brep_10 = Brep(test_geometry_5)
tool_5 = Tool(
    meshes=mesh_5,
    breps=brep_10,
    G=rotate_2.Geometry,
    G_2=rotate_3.Geometry,
    nozzle_distance_from_holder=nozzle_distance_from_holder)

# ----
filter = StreamFilter(Gate=tool_id_2, Stream1=tool, Stream2=tool_3, Stream3=tool_4, Stream4=tool_5)
py = PythonScript(tool=filter)  # -> tcp_frame, model
# ---------- py: Python ----------
from compas_ghpython import mesh_draw 

tcp_frame = tool.tcp_frame
model = map(mesh_draw, tool.model)
# ---------- end py ----------
tool_6 = Data(filter)
draw = PythonScript(frame=py.tcp_frame)  # -> G, C
# ---------- draw: Python ----------
import Rhino.Geometry as rg
from System.Drawing import Color

if not size:
    size = 100

if frame:
    plane = rg.Plane(rg.Point3d(*list(frame.point)), rg.Vector3d(*list(frame.xaxis)), rg.Vector3d(*list(frame.yaxis)))

    G = []
    G.append(rg.Line(plane.Origin, size * plane.XAxis))
    G.append(rg.Line(plane.Origin, size * plane.YAxis))
    G.append(rg.Line(plane.Origin, size * plane.ZAxis))
    
    C = []
    C.append(Color.FromArgb(255, 0, 0))
    C.append(Color.FromArgb(0, 255, 0))
    C.append(Color.FromArgb(0, 0, 255))
# ---------- end draw ----------
tool_7 = ClusterOutput(tool_6)
preview = CustomPreview(Geometry=draw.G, Shader=draw.C)
preview_2 = CustomPreview(Geometry=py.model, Shader=ColourSwatch(SwatchColor=RGB(141, 170, 178)))

# ==== cluster Cluster
distance_between_points = ClusterInput()
distance_from_z0 = ClusterInput()
end_plane_rotation = ClusterInput()
layer_height = ClusterInput()
C = ClusterInput()
bbox = BoundingBox(Content=C, PWorldXY=PlaneXY(0, 0, 0))  # -> Box, Box_2
debrep = DeconstructBrep(Brep=bbox.Box)  # -> reverse(Faces), Edges, Vertices

debox = DeconstructBox(Box=bbox.Box)  # -> Plane, X, Y, Z
dedomain = DeconstructDomain(Domain=debox.Y)  # -> Start, End
dedomain_2 = DeconstructDomain(Domain=debox.X)  # -> Start, End
dedomain_3 = DeconstructDomain(Domain=debox.Z)  # -> Start, End
max = Maximum(A=dedomain_2.End, B=dedomain.End)
min = Minimum(A=dedomain_2.Start, B=dedomain.Start)
abs = Absolute(Value=dedomain_3.Start)
abs_2 = Absolute(Value=min)
addition = Addition(A=abs, B=dedomain_3.End)
addition_2 = Addition(A=abs_2, B=max)
multiplication = Multiplication(A=addition, B15=1.5)
multiplication_2 = Multiplication(A=addition_2, B15=1.5)
division = Division(A=multiplication, B=layer_height)
round = Round(Number=division)  # -> Nearest, Floor, Ceiling
Z = UnitZ(Factor=1)
spiral = Spirale(
    AxisStart=Point(0, 0, 0),
    AxisDirection=Z,
    HelixStart=Point(0, 1, 0),
    Pitch=layer_height,
    TurnCount=round.Floor,
    R1=multiplication_2,
    R2=multiplication_2)

area = Area(Geometry=debrep.Faces)  # -> Area, Centroid
scale = Scale(Geometry=debrep.Faces, Center=area.Centroid, Factor=Slider(2, range=0..10))  # -> Geometry, Transform
item = ListItem(List=scale.Geometry, Index=0, WTrue=True)  # -> Item, Item1

srf = Surface(item.Item1)
Z_2 = UnitZ(Factor=distance_from_z0)
move = Move(Geometry=srf, Motion=Z_2)  # -> Geometry, Transform

debrep_2 = DeconstructBrep(Brep=move.Geometry)  # -> Faces, Edges, Vertices
item_2 = ListItem(List=debrep_2.Vertices, Index=0, WTrue=True)  # -> Item, Item1, Item2, Item3
crv = Curve(spiral)
bbox_2 = BoundingBox(Content=crv, PWorldXY=PlaneXY(0, 0, 0))  # -> Box, Box_2
mesh = Mesh(C)
bbox_3 = BoundingBox(Content=mesh, PWorldXY=PlaneXY(0, 0, 0))  # -> Box, Box_2
xy = XYPlane(Origin=Point(0, 0, 0))
xz = XZPlane(Origin=Point(0, 0, 0))
volume = Volume(Geometry=bbox_3.Box_2)  # -> Volume, Centroid

area_2 = Area(Geometry=item.Item)  # -> Area, Centroid
neg = Negative(Value=end_plane_rotation)
xz_2 = XZPlane(Origin=area_2.Centroid)
rotate = Rotate(Geometry=item.Item, Angle=degrees(neg), Plane=xz_2)  # -> Geometry, Transform
Z_3 = UnitZ(Factor=Slider(23, range=0..100))

neg_2 = Negative(Value=Z_3)

move_2 = Move(Geometry=rotate.Geometry, Motion=neg_2)  # -> Geometry, Transform

debrep_3 = DeconstructBrep(Brep=move_2.Geometry)  # -> Faces, Edges, Vertices
item_3 = ListItem(List=debrep_3.Vertices, Index=0, WTrue=True)  # -> Item, Item1, Item2, Item3
tbox = TwistedBox(
    CornerA=item_3.Item,
    CornerB=item_3.Item1,
    CornerC=item_3.Item2,
    CornerD=item_3.Item3,
    CornerE=item_2.Item,
    CornerF=item_2.Item1,
    CornerG=item_2.Item2,
    CornerH=item_2.Item3)
morph = BoxMorph(Geometry=crv, Reference=bbox_2.Box, Target=tbox)
rotate_2 = Rotate(Geometry=xy, Angle=degrees(neg), Plane=xz)  # -> Geometry, Transform
divlength = DivideLength(Curve=morph, Length=distance_between_points)  # -> Points, Tangents, Parameters
lng = ListLength(List=divlength.Points)
vec2pt = Vector2Pt(PointA=divlength.Points, PointB=volume.Centroid, Unitize=False)  # -> Vector, Length
range = Range(D0To1=Domain(0, 1), Steps=lng)
devec = DeconstructVector(Vector=vec2pt.Vector)  # -> XComponent, YComponent, ZComponent
twn2plns = TweenTwoPlanes(PlaneA=xy, PlaneB=rotate_2.Geometry, Factor=range, Quaternion=True)
vec = VectorXYZ(XComponent=devec.XComponent, YComponent=devec.YComponent, ZComponent=0)  # -> Vector, Length
rev = ReverseList(List=twn2plns)
pl_origin = PlaneOrigin(Base=rev, Origin=divlength.Points)
align = AlignPlane(Plane=pl_origin, Direction=vec.Vector)  # -> Plane, Angle
deplane = DeconstructPlane(Plane=align.Plane)  # -> Origin, XAxis, YAxis, ZAxis
project = ProjectPoint(Point=divlength.Points, Direction=deplane.XAxis, Geometry=mesh)  # -> Point, Index
print_path = ClusterOutput(project.Point)

# ==== cluster Cluster_2
distance_between_points = ClusterInput()
distance_from_z0 = ClusterInput()
end_plane_rotation = ClusterInput()
layer_height = ClusterInput()
C = ClusterInput()
bbox = BoundingBox(Content=C, PWorldXY=PlaneXY(0, 0, 0))  # -> Box, Box_2
debrep = DeconstructBrep(Brep=bbox.Box)  # -> reverse(Faces), Edges, Vertices

debox = DeconstructBox(Box=bbox.Box)  # -> Plane, X, Y, Z
dedomain = DeconstructDomain(Domain=debox.Y)  # -> Start, End
dedomain_2 = DeconstructDomain(Domain=debox.X)  # -> Start, End
dedomain_3 = DeconstructDomain(Domain=debox.Z)  # -> Start, End
max = Maximum(A=dedomain_2.End, B=dedomain.End)
min = Minimum(A=dedomain_2.Start, B=dedomain.Start)
abs = Absolute(Value=dedomain_3.Start)
abs_2 = Absolute(Value=min)
addition = Addition(A=abs, B=dedomain_3.End)
addition_2 = Addition(A=abs_2, B=max)
multiplication = Multiplication(A=addition, B15=1.5)
multiplication_2 = Multiplication(A=addition_2, B15=1.5)
division = Division(A=multiplication, B=layer_height)
round = Round(Number=division)  # -> Nearest, Floor, Ceiling
Z = UnitZ(Factor=1)
spiral = Spirale(
    AxisStart=Point(0, 0, 0),
    AxisDirection=Z,
    HelixStart=Point(0, 1, 0),
    Pitch=layer_height,
    TurnCount=round.Floor,
    R1=multiplication_2,
    R2=multiplication_2)

area = Area(Geometry=debrep.Faces)  # -> Area, Centroid
scale = Scale(Geometry=debrep.Faces, Center=area.Centroid, Factor=Slider(2, range=0..10))  # -> Geometry, Transform
item = ListItem(List=scale.Geometry, Index=0, WTrue=True)  # -> Item, Item1

srf = Surface(item.Item1)
Z_2 = UnitZ(Factor=distance_from_z0)
move = Move(Geometry=srf, Motion=Z_2)  # -> Geometry, Transform

debrep_2 = DeconstructBrep(Brep=move.Geometry)  # -> Faces, Edges, Vertices
item_2 = ListItem(List=debrep_2.Vertices, Index=0, WTrue=True)  # -> Item, Item1, Item2, Item3
crv = Curve(spiral)
bbox_2 = BoundingBox(Content=crv, PWorldXY=PlaneXY(0, 0, 0))  # -> Box, Box_2
mesh = Mesh(C)
bbox_3 = BoundingBox(Content=mesh, PWorldXY=PlaneXY(0, 0, 0))  # -> Box, Box_2
xy = XYPlane(Origin=Point(0, 0, 0))
xz = XZPlane(Origin=Point(0, 0, 0))
volume = Volume(Geometry=bbox_3.Box_2)  # -> Volume, Centroid

area_2 = Area(Geometry=item.Item)  # -> Area, Centroid
neg = Negative(Value=end_plane_rotation)
xz_2 = XZPlane(Origin=area_2.Centroid)
rotate = Rotate(Geometry=item.Item, Angle=degrees(neg), Plane=xz_2)  # -> Geometry, Transform
Z_3 = UnitZ(Factor=Slider(23, range=0..100))

neg_2 = Negative(Value=Z_3)

move_2 = Move(Geometry=rotate.Geometry, Motion=neg_2)  # -> Geometry, Transform

debrep_3 = DeconstructBrep(Brep=move_2.Geometry)  # -> Faces, Edges, Vertices
item_3 = ListItem(List=debrep_3.Vertices, Index=0, WTrue=True)  # -> Item, Item1, Item2, Item3
tbox = TwistedBox(
    CornerA=item_3.Item,
    CornerB=item_3.Item1,
    CornerC=item_3.Item2,
    CornerD=item_3.Item3,
    CornerE=item_2.Item,
    CornerF=item_2.Item1,
    CornerG=item_2.Item2,
    CornerH=item_2.Item3)
morph = BoxMorph(Geometry=crv, Reference=bbox_2.Box, Target=tbox)
rotate_2 = Rotate(Geometry=xy, Angle=degrees(neg), Plane=xz)  # -> Geometry, Transform
divlength = DivideLength(Curve=morph, Length=distance_between_points)  # -> Points, Tangents, Parameters
lng = ListLength(List=divlength.Points)
vec2pt = Vector2Pt(PointA=divlength.Points, PointB=volume.Centroid, Unitize=False)  # -> Vector, Length
range = Range(D0To1=Domain(0, 1), Steps=lng)
devec = DeconstructVector(Vector=vec2pt.Vector)  # -> XComponent, YComponent, ZComponent
twn2plns = TweenTwoPlanes(PlaneA=xy, PlaneB=rotate_2.Geometry, Factor=range, Quaternion=True)
vec = VectorXYZ(XComponent=devec.XComponent, YComponent=devec.YComponent, ZComponent=0)  # -> Vector, Length
rev = ReverseList(List=twn2plns)
pl_origin = PlaneOrigin(Base=rev, Origin=divlength.Points)
align = AlignPlane(Plane=pl_origin, Direction=vec.Vector)  # -> Plane, Angle
deplane = DeconstructPlane(Plane=align.Plane)  # -> Origin, XAxis, YAxis, ZAxis
project = ProjectPoint(Point=divlength.Points, Direction=deplane.XAxis, Geometry=mesh)  # -> Point, Index
pl_origin_2 = PlaneOrigin(Base=align.Plane, Origin=project.Point)
print_path = ClusterOutput(project.Point)
planes = ClusterOutput(pl_origin_2)

# ==== cluster Tool
nozzle_distance_from_holder = ClusterInput()
meshes = ClusterInput()
breps = ClusterInput()
G = ClusterInput()
G_2 = ClusterInput()
subtraction = Subtraction(A=nozzle_distance_from_holder, B5085=50.85)
null = NullItem(Item=nozzle_distance_from_holder)  # -> NullFlags, InvalidFlags, Description
filter = StreamFilter(Gate=null.NullFlags, Stream0=subtraction, Stream1="0")
Z = UnitZ(Factor=filter)
meshes_2 = Mesh(meshes)
mjoin = MeshJoin(Meshes=meshes_2)
move = Move(Geometry=G_2, Motion=Z)  # -> Geometry, Transform
move_2 = Move(Geometry=G, Motion=Z)  # -> Geometry, Transform
tool = PythonScript(meshes=mjoin, breps=breps, xline=move_2.Geometry, yline=move.Geometry)  # -> tool; inputs meshes: list of Mesh, breps: list of Brep
# ---------- tool: Python ----------
import Rhino.Geometry as rg
from compas.geometry import Frame
from ur_online_control.ur.tool import Tool
from compas.datastructures import Mesh
from compas_rhino.helpers import mesh_from_guid

xaxis = rg.Line(xline.PointAtStart, xline.PointAtEnd)
yaxis = rg.Line(yline.PointAtStart, yline.PointAtEnd)

if xaxis.From.DistanceTo(yaxis.From) < 0.01:
    origin = xaxis.From
    xaxis = xaxis.Direction
    yaxis = yaxis.Direction
elif xaxis.To.DistanceTo(yaxis.To) < 0.01:
    origin = xaxis.To
    xaxis = -xaxis.Direction
    yaxis = -yaxis.Direction
elif xaxis.From.DistanceTo(yaxis.To) < 0.01:
    origin = xaxis.From
    xaxis = xaxis.Direction
    yaxis = -yaxis.Direction
elif xaxis.To.DistanceTo(yaxis.From) < 0.01:
    origin = xaxis.To
    xaxis = -xaxis.Direction
    yaxis = yaxis.Direction

xaxis.Unitize()
yaxis.Unitize()

print origin
print xaxis
print yaxis

tcp_frame = Frame(origin, xaxis, yaxis)

tool = Tool(tcp_frame)
tool.model = [mesh_from_guid(Mesh, mesh) for mesh in meshes]
#tool.model_xyz = tool.model.xyz
tool.breps = breps
# ---------- end tool ----------
tool_2 = ClusterOutput(tool)
